# Grasshopper definition 变位器.gh (Grasshopper 0.9.76)
# plug-ins: GHCmpTest, KUKA|prc - parametric robot control, FUROBOT, RobotKUKA

xy = XYPlane(Origin=Point(0, 0, 0))
number_slider = Slider(5, range=0..10)
number_slider_2 = Slider(36, range=0..100)
mesh = Mesh(<mesh referenced from the Rhino model>)
number_slider_3 = Slider(100, range=0..1000)
cc = CreateContour(
    Geometry=mesh,
    LayerHeight=Slider(25, range=0..100),
    BaseLayerNumber=Slider(0, range=0..100),
    SeamGeometry=xy,
    EndLength=10,
    SeamSlopeRatio=4)  # -> flatten(CutCurve)
dbsl = DivideBySegWithLength(Curve=cc, Length=Slider(30, range=0..100), Len=30)
points = PointList(Points=dbsl, Size=Slider(13, range=0..100))
srf = Surface(<surface referenced from the Rhino model>)
srf_cp = SurfaceClosestPoint(Point=dbsl, Surface=srf)  # -> Point, UVPoint, Distance
T = LightPlasticToolhead(Index=1)
vec2pt = Vector2Pt(PointA=dbsl, PointB=srf_cp.Point, Unitize=False)  # -> Vector, Length
number_slider_4 = Slider(35, range=0..100)
number_slider_5 = Slider(32, range=0..100)
number_slider_6 = Slider(0, range=0..100)
number_slider_7 = Slider(0, range=0..100)
R = KR120R2500(Tool=T, InitSet="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")
pl = PlaneNormal(Origin=dbsl, ZAxis=vec2pt.Vector)
Z = UnitZ(Factor=-1)
align = AlignPlane(Plane=pl, Direction=Z)  # -> flatten(Plane), Angle
lng = ListLength(List=align.Plane)
series = Series(Start=0, Step=Slider(10, range=0..10), Count=lng)
panel = Panel(series)
mesh_2 = Mesh(<mesh referenced from the Rhino model>)
gsfp = GetSaveFilePath(filePath="G:\Work\FabUnionRobot\FUROBOT\Resources\turntable2dof\tb_2d_g_1")
number_slider_8 = Slider(1000, range=0..1000)
nickname = ExportMeshToByte(Mesh=mesh_2, Path=gsfp)  # disabled
kr_90_270_r2500 = KUKAQuantecKR90KR270R2500(infiniterot=False)
kuka_spindle = KUKAHSDSpindle(ToolLength=Slider(100, range=0..1000), ToolDiameter=10, ToolNumber=6)
m2xyzabc = GetMatrixFromXYZABC(X=Slider(1500, range=0..10000), Y=0, Z=Slider(830, range=0..1000), A=0, B=0, C=0)  # -> XYZABC, Matrix
lin_move = KUKAPrcLINearMovement(TargetAsPlane=align.Plane, extaxenabled=True, interpolation="C_DIS")  # -> flatten(KUKAPrcCommand)
dkp400 = DKP400KUKAPrc(
    KUKAPrcRobotInput=kr_90_270_r2500,
    infiniterot=True,
    root_aval="0.0",
    root_bval="0.0",
    root_cval="0.0",
    root_xval="1500.0",
    root_yval="0.0",
    root_zval="830.0",
    switchedes=True)
turntable = TurnTable(Robot=R, P=m2xyzabc.XYZABC)
turntable2dof = TurnTable2Dof(Robot=R, P=m2xyzabc.XYZABC)
transform = Transform(Geometry=flatten(align.Plane), Transform=m2xyzabc.Matrix)
kuka_prc = KUKAPrcCORE(
    SimulationSlider=Slider(0.35725, range=0..1),
    KUKAPrcCommands=lin_move,
    KUKAPrcTool=kuka_spindle,
    KUKAPrcRobot=dkp400,
    PRC_BaseExpose=False,
    PRC_SaveNameExpose=False,
    PRCsettings="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")  # -> flatten(RobotGeometry), AnalysisOutput
panel_2 = Panel(transform)
number_slider_9 = Slider(1, range=0..1)
c_script = CSharpScript()  # -> out, A
# ---------- c_script: C# ----------
    Console.WriteLine("aaa");
    Console.ReadLine();
# ---------- end c_script ----------
gpg = RenderPlaneGeo(Plane=transform, Scale=100)
number_slider_10 = Slider(0, range=0..100)
points_2 = PointList(Points=transform, Size=Slider(7, range=0..10))
shift = ShiftList(List=transform, Shift=1, Wrap=True)
item = ListItem(List=transform, Index=0, Wrap=True)  # -> Item, Item1
panel_3 = Panel(item.Item1)
panel_4 = Panel(lin_move)
panel_5 = Panel(item.Item)
orient = Orient(Source=item.Item, Target=item.Item1)  # -> Geometry, Transform
orient_2 = Orient(Source=transform, Target=shift)  # -> Geometry, Transform
m2r = GetRotVecFromMatrix(Matrix=orient_2.Transform)  # -> X, Y, Z, Rx, Ry, Rz
m2r_2 = GetRotVecFromMatrix(Matrix=orient.Transform)  # -> X, Y, Z, Rx, Ry, Rz
deg = Degrees(Radians=m2r_2.Rz)
panel_7 = Panel(shift)
panel_8 = Panel(deg)
deg_2 = Degrees(Radians=m2r.Rz)
panel_9 = Panel(deg_2)
multiplication = Multiplication(A=deg_2, B=Slider(-1, range=-1..0))
c_script_2 = CSharpScript(x=multiplication)  # -> out, A; inputs x: list of Double
# ---------- c_script_2: C# ----------
    int num = x.Count;
    List<double> TurnValue = new List<double>();
    TurnValue.Add(0);
    for(int i = 0;i < num-1;i++)
    {
      TurnValue.Add(TurnValue[i] + x[i]);
    }
    A = TurnValue;
# ---------- end c_script_2 ----------
eac = ExternalAxisCompose(Point=transform, E1=Slider(0, range=-100..100), E2=c_script_2.A, E3=0, E4=0)
nickname_2 = LineCmd(Plane=transform, EAxis=eac, Zone=10)  # -> flatten(LineCmd)
item_2 = ListItem(List=nickname_2, Index=number_slider_9, Wrap=True)
core = RobotCore(
    Simulation=Slider(0.530086, range=0..1),
    Command=nickname_2,
    Robot=turntable2dof,
    AngLimitSwt="True",
    AutoTCPSwt="True",
    CollideSwt="True",
    FileSwt="True",
    TrajColorKey="-8355712",
    TrajectorySwt="False")  # -> Angle, TCP, AllTCPs, Geo, RootPlane, CheckInfo, E
hp = HttpPost(ID=number_slider_9, Command=item_2, URL="http://localhost:5000/", Enable=Toggle(False))
panel_10 = Panel(hp)
panel_12 = Panel(c_script_2.A)
