# Grasshopper definition 变位器v2.gh (Grasshopper 0.9.76)
# plug-ins: FUROBOT, RobotKUKA

xy = XYPlane(Origin=Point(0, 0, 0))
mesh = Mesh(<mesh referenced from the Rhino model>)
number_slider = Slider(100, range=0..1000)
cc = CreateContour(
    Geometry=mesh,
    LayerHeight=Slider(25, range=0..100),
    BaseLayerNumber=Slider(0, range=0..100),
    SeamGeometry=xy,
    EndLength=10,
    SeamSlopeRatio=4)  # -> flatten(CutCurve)
dbsl = DivideBySegWithLength(Curve=cc, Length=Slider(30, range=0..100), Len=30)
points = PointList(Points=dbsl, Size=Slider(13, range=0..100))
srf = Surface(<surface referenced from the Rhino model>)
srf_cp = SurfaceClosestPoint(Point=dbsl, Surface=srf)  # -> Point, UVPoint, Distance
T = LightPlasticToolhead(Index=1)
vec2pt = Vector2Pt(PointA=dbsl, PointB=srf_cp.Point, Unitize=False)  # -> Vector, Length
pl = PlaneNormal(Origin=dbsl, ZAxis=vec2pt.Vector)
Z = UnitZ(Factor=-1)
align = AlignPlane(Plane=pl, Direction=Z)  # -> flatten(Plane), Angle
R = KR120R2500(Tool=T, InitSet="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")
number_slider_2 = Slider(0, range=-100..15)
number_slider_3 = Slider(1767, range=0..10000)
number_slider_4 = Slider(830, range=0..1000)
number_slider_5 = Slider(0, range=-100..15)
m2xyzabc = GetMatrixFromXYZABC(
    X=Slider(1767, range=0..10000),
    Y=0,
    Z=Slider(830, range=0..1000),
    A=0,
    B=Slider(0, range=-100..15),
    C=Slider(0, range=-100..15))  # -> XYZABC, Matrix
transform = Transform(Geometry=flatten(align.Plane), Transform=m2xyzabc.Matrix)
panel = Panel(transform)
mesh_2 = Mesh(<mesh referenced from the Rhino model>)
mesh_3 = Mesh(<mesh referenced from the Rhino model>)
mesh_4 = Mesh(<mesh referenced from the Rhino model>)
composerobotmesh = ComposeRobotMesh(Mesh=mesh_3, Mat=ColourSwatch(SwatchColor=RGB(224, 224, 224)))
composerobotmesh_2 = ComposeRobotMesh(Mesh=mesh_4, Mat=ColourSwatch(SwatchColor=RGB(255, 255, 255)))
composerobotmesh_3 = ComposeRobotMesh(Mesh=mesh_2, Mat=ColourSwatch(SwatchColor=RGB(255, 255, 255)))
toggle = BooleanToggle(True)
Y = UnitY(Factor=-1)
shift = ShiftList(List=transform, Shift=1, Wrap=True)
m2xyzabc_2 = GetMatrixFromXYZABC(X=0, Y=0, Z=0, A=0, B=0, C=0)  # -> XYZABC, Matrix
Z_2 = UnitZ(Factor=1)

# ---- group: DKP400
turntable2dof = TurnTable2Dof(Robot=R, P=m2xyzabc.XYZABC)

# ----
pt = Point(<point referenced from the Rhino model>)
pt_2 = Point(<point referenced from the Rhino model>)
ceap = ComposeCustomEAPart(
    RobotMesh=composerobotmesh_3,
    Vector=Vector(1, 0, 0),
    ValueID=0,
    ValueLimit=Domain(-10000, 10000),
    IsCoupling=True,
    IsRotate=False,
    RotateOrigin=null)
orient = Orient(Source=transform, Target=shift)  # -> Geometry, Transform
ceap_2 = ComposeCustomEAPart(
    RobotMesh=composerobotmesh_2,
    Vector=Y,
    ValueID=Slider(1, range=0..1),
    ValueLimit=Domain(-10000, 10000),
    IsCoupling=True,
    IsRotate=toggle,
    RotateOrigin=pt)
ceap_3 = ComposeCustomEAPart(
    RobotMesh=composerobotmesh,
    Vector=Z_2,
    ValueID=Slider(2, range=0..10),
    ValueLimit=Domain(-10000, 10000),
    IsCoupling=True,
    IsRotate=toggle,
    RotateOrigin=pt_2)
m2r = GetRotVecFromMatrix(Matrix=orient.Transform)  # -> X, Y, Z, Rx, Ry, Rz
number_slider_6 = Slider(0, range=0..100)
xy_2 = XYPlane(Origin=pt_2)
deg = Degrees(Radians=m2r.Rz)
eag = EAGroup(Plane=xy_2, TCP=Toggle(True), Display=True, P0=ceap, P1=ceap_2, P2=ceap_3)
panel_2 = Panel(deg)
multiplication = Multiplication(A=deg, B=Slider(-1, range=-1..0))
nickname = ComposeExternalAxisV2(Robot=R, TCP=eag)

# ---- group: 变位器
c_script = CSharpScript(x=multiplication)  # -> out, A; inputs x: list of Double
# ---------- c_script: C# ----------
    int num = x.Count;
    List<double> TurnValue = new List<double>();
    TurnValue.Add(0);
    for(int i = 0;i < num - 1;i++)
    {
      TurnValue.Add(TurnValue[i] + x[i]);
    }
    A = TurnValue;
# ---------- end c_script ----------

# ----
panel_3 = Panel(c_script.A)
eac = ExternalAxisCompose(Point=transform, E1=Slider(0, range=-100..100), E2=c_script.A, E3=0, E4=0)
nickname_2 = LineCmd(Plane=transform, EAxis=eac, Zone=10)  # -> flatten(LineCmd)
core = RobotCore(
    Simulation=Slider(0.7127, range=0..1),
    Command=nickname_2,
    Robot=nickname,
    AngLimitSwt="True",
    AutoTCPSwt="True",
    CollideSwt="True",
    FileSwt="True",
    PreviewSwt="True",
    TrajColorKey="-8355712",
    TrajectorySwt="True")  # -> Angle, TCP, AllTCPs, Geo, RootPlane, CheckInfo, E
