# Grasshopper definition RSIDemo1.gh (Grasshopper 0.9.76)
# plug-ins: FUROBOT

nickname = GetUDP(LocalPort=Slider(59153, range=0..100000), Enable=Button())
cga = ComposeGeneralAngle(
    A1=Slider(65, range=0..100),
    A2=Slider(-100, range=-100..0),
    A3=Slider(70, range=0..100),
    A4=Slider(-15, range=-90..100),
    A5=Slider(40, range=-50..100),
    A6=Slider(43.02, range=-340..340))
rsi = RSIJoint(UDPClient=nickname, Angle=cga, V=Slider(15, range=0..100))  # -> Received, Sent, Q1V, Q2V, Q3V, Q4V, Q5V, Q6V
