# Grasshopper definition RSIDemo2.gh (Grasshopper 0.9.76)
# plug-ins: FUROBOT, RobotKUKA

T = LightPlasticToolhead(Index=1)
R = AgilusKR6KR10R900(Tool=T, InitSet="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")
crv = Curve(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)
dbsl = DivideBySegWithLength(Curve=crv, Length=8, Len=8)
xy = XYPlane(Origin=dbsl)
deplane = DeconstructPlane(Plane=xy)  # -> Origin, XAxis, YAxis, ZAxis
rot3d = Rotate3D(Geometry=xy, Angle=degrees(Slider(90, range=0..100)), Center=deplane.Origin, Axis=deplane.YAxis)  # -> Geometry, Transform
gpg = RenderPlaneGeo(Plane=rot3d.Geometry, Scale=100)
nickname = LineCmd(Plane=rot3d.Geometry, Zone=10)
core = RobotCore(
    Simulation=Slider(1, range=0..1),
    Command=nickname,
    Robot=R,
    AngLimitSwt="True",
    AutoTCPSwt="True",
    CollideSwt="True",
    FileSwt="False",
    PreviewSwt="True",
    TrajColorKey="-8355712",
    TrajectorySwt="True")  # -> Joint, TCP, AllTCPs, Geo, RootPlane, CheckInfo, E
nickname_2 = Deconstruct6axisAngle(Joint=core.Joint)  # -> A1, A2, A3, A4, A5, A6
cga = ComposeGeneralAngle(A1=nickname_2.A1, A2=nickname_2.A2, A3=nickname_2.A3, A4=nickname_2.A4, A5=nickname_2.A5, A6=nickname_2.A6)
number_slider = Slider(65, range=0..100)
number_slider_2 = Slider(-100, range=-100..0)
number_slider_3 = Slider(70, range=0..100)
number_slider_4 = Slider(-15, range=-90..100)
number_slider_5 = Slider(40, range=-50..100)
number_slider_6 = Slider(43.02, range=-340..340)
nickname_3 = GetUDP(LocalPort=Slider(59153, range=0..100000), Enable=Button())
rsi = RSIJoint(UDPClient=nickname_3, Angle=cga, V=Slider(15, range=0..100))  # -> Received, Sent, Q1V, Q2V, Q3V, Q4V, Q5V, Q6V
