# Grasshopper definition 2link.gh (Grasshopper 1.0.7)
# plug-ins: FURobot

mesh = Mesh(<mesh referenced from the Rhino model>)
mesh_2 = Mesh(<mesh referenced from the Rhino model>)
mesh_3 = Mesh(<mesh referenced from the Rhino model>)
mesh_4 = Mesh(<mesh referenced from the Rhino model>)
mesh_5 = Mesh(<mesh referenced from the Rhino model>)
construct_domain = ConstructDomain(DomainStart=Slider(-180, range=-1000..-180), DomainEnd=Slider(180, range=0..1000))
colour_swatch = ColourSwatch(SwatchColor=RGB(214, 214, 214))
colour_swatch_2 = ColourSwatch(SwatchColor=RGB(255, 255, 255))
construct_point = ConstructPoint(XCoordinate=0, YCoordinate=0, ZCoordinate=0)
construct_point_2 = ConstructPoint(XCoordinate=Slider(1800, range=0..10000), YCoordinate=0, ZCoordinate=0)
construct_point_3 = ConstructPoint(XCoordinate=Slider(900, range=0..1000), YCoordinate=0, ZCoordinate=0)
construct_robot_link = ConstructRobotLink(Mesh=mesh, Mat=ColourSwatch(SwatchColor=RGB(69, 69, 69)))
construct_robot_link_2 = ConstructRobotLink(Mesh=mesh_5, Mat=ColourSwatch(SwatchColor=RGB(204, 204, 204)))
construct_robot_link_3 = ConstructRobotLink(Mesh=mesh_2, Mat=colour_swatch_2)
construct_robot_link_4 = ConstructRobotLink(Mesh=mesh_3, Mat=ColourSwatch(SwatchColor=RGBA(255, 89, 0, 144)))
unit_z = UnitZ(Factor=Slider(1000, range=0..1000))
construct_robot_link_5 = ConstructRobotLink(Mesh=mesh_4, Mat=colour_swatch_2)
unit_z_2 = UnitZ(Factor=1)
construcrotationjoint = ConstrucRotationJoint(Ω=Vector(0, 0, 1), P=construct_point_2, Limit=Domain(nan, nan))
construct_robot_link_group = ConstructRobotLinkGroup(Link1=construct_robot_link_3)
mesh_6 = Mesh(<mesh referenced from the Rhino model>)
construct_robot_link_group_2 = ConstructRobotLinkGroup(Link1=construct_robot_link)
construct_robot_link_group_3 = ConstructRobotLinkGroup(Link1=construct_robot_link_2)
construct_robot_link_group_4 = ConstructRobotLinkGroup(Link1=construct_robot_link_4)
construct_robot_link_group_5 = ConstructRobotLinkGroup(Link1=construct_robot_link_5)
construcrotationjoint_2 = ConstrucRotationJoint(Ω=Vector(0, 0, 1), P=construct_point_3, Limit=Domain(nan, nan))
construcrotationjoint_3 = ConstrucRotationJoint(Ω=unit_z_2, P=construct_point, Limit=construct_domain)
construct_moving_joint = ConstructMovingJoint(Ν=unit_z, Limit=Domain(nan, nan))
construct_robot_link_6 = ConstructRobotLink(Mesh=mesh_6, Mat=ColourSwatch(SwatchColor=RGB(133, 133, 133)))
number_slider = Slider(980, range=0..1000)
merge = Merge(Data1=construct_moving_joint, Data2=construcrotationjoint_3, Data3=construcrotationjoint_2, Data4=construcrotationjoint)
getmatrixfromxyzabc = GetMatrixFromXYZABC(X=0, Y=0, Z=Slider(-100, range=-100..-99), A=0, B=0, C=0)  # -> XYZABC, Matrix
number_slider_2 = Slider(1000, range=0..1000)
merge_2 = Merge(
    Data1=construct_robot_link_group_2,
    Data2=construct_robot_link_group_3,
    Data3=construct_robot_link_group,
    Data4=construct_robot_link_group_4,
    Data5=construct_robot_link_group_5)
number_slider_3 = Slider(700, range=0..1000)
construct_point_4 = ConstructPoint(XCoordinate=Slider(1800, range=0..10000), YCoordinate=0, ZCoordinate=Slider(1000, range=0..1000))
curve = Curve(<curve referenced from the Rhino model>)
custom_tool = CustomTool(Link=construct_robot_link_6, Transform=getmatrixfromxyzabc.Matrix, Normal=0, Usage=2)
merge_3 = Merge(
    Data1=Slider(200, range=0..1000),
    Data2=Slider(-70, range=-100..-70),
    Data3=Slider(60, range=0..100),
    Data4=Slider(0, range=0..100))
dividebysegwithlength = DivideBySegWithLength(Curve=curve, Length=Slider(100, range=0..100), Len=100)
xy_plane = XYPlane(Origin=construct_point_4)
xy_plane_2 = XYPlane(Origin=dividebysegwithlength)
construct_x_cmd_ptp_extend_v3 = Construct_X_CMD_PTP_extend_v3(Plane=xy_plane_2, RotJointVel=10, MovJointVel=100)
custom_robot_arm = CustomRobotArm(Tool=custom_tool, Flange=xy_plane, Joint=merge, Link=merge_2, Root=PlaneXY(0, 0, 0), JointValue=merge_3)
line_command = LineCommand(PLane=xy_plane_2, LineVel=100)
renderplanegeo = RenderPlaneGeo(Plane=xy_plane_2, Scale=100)
robotarmsimulator = RobotArmSimulator(Slider=Slider(1, range=0..1), Robot=custom_robot_arm, CMD=line_command)  # -> Joint, Geo, Traj, Task
panel = Panel(robotarmsimulator.Joint)
