# Grasshopper definition FURobotPython.gh (Grasshopper 1.0.7)
# plug-ins: FURobot

create_euler_angles = CreateEulerAngles(A=Slider(19.48, range=-90..90), B=Slider(14.9, range=-90..90), C=Slider(20.97, range=-90..90))
rotation_parameter_conversion = RotationParameterConversion(Euler=create_euler_angles, Input=0, Output=6)  # -> Euler, Matrix, Quat, AxisAng, RotateVec
vec = VectorXYZ(XComponent=Slider(1000, range=0..1000), YComponent=Slider(300, range=0..1000), ZComponent=Slider(500, range=0..1000))  # -> Vector, Length
panel = Panel(rotation_parameter_conversion.Euler)
move = Move(Motion=vec.Vector)  # -> Geometry, Transform
merge = Merge(Data1=rotation_parameter_conversion.Matrix, Data2=move.Transform)
comp = Compound(Transforms=merge)

# ---- group: From矩阵
python = GhPythonScript(TF=comp)  # -> out, Euler, quaternion, angle_axis, rotation_vector; inputs TF: Transform
# ---------- python: Python ----------
__author__ = "LmShare"
__version__ = "2024.04.03"

import rhinoscriptsyntax as rs
import sys
import clr
import Rhino

sys.path.append('C:\gha\FUROBOT')
clr.AddReference('FUMath')
clr.AddReference('FUROBOTCore')
import MyMath
import FUROBOTCore

x=TF[0,3]
y=TF[1,3]
z=TF[2,3]

rh_mat=Rhino.Geometry.Matrix(TF)
order=MyMath.EulerAngleOrder.ZYX

rh_tf=FUROBOTCore.MathCommon.ConvertToTransform(rh_mat)
rigid_tf=FUROBOTCore.MathCommon.GetRigidTransform(rh_tf)

euler_angle=MyMath.EulerAngle(rigid_tf,order)

a=euler_angle.A_deg
b=euler_angle.B_deg
c=euler_angle.C_deg

Euler=euler_angle

quat=rigid_tf.GetQuat()
quaternion=quat
w=quat.W
x=quat.X

angle_axis=MyMath.AxisAngle(quat)

rotation_vector=MyMath.RotationVector(angle_axis)
# ---------- end python ----------

# ---- group: 分解
python_2 = GhPythonScript(TF=comp)  # -> out, Euler, a, b, c, x, y, z, euler_order; inputs TF: Transform
# ---------- python_2: Python ----------
__author__ = "LmShare"
__version__ = "2024.04.03"

import rhinoscriptsyntax as rs
import sys
import clr
import Rhino

sys.path.append('C:\gha\FUROBOT')
clr.AddReference('FUMath')
clr.AddReference('FUROBOTCore')
import MyMath
import FUROBOTCore

x=TF[0,3]
y=TF[1,3]
z=TF[2,3]

rh_mat=Rhino.Geometry.Matrix(TF)

order=MyMath.EulerAngleOrder.ZYX

rh_tf=FUROBOTCore.MathCommon.ConvertToTransform(rh_mat)
rigid_tf=FUROBOTCore.MathCommon.GetRigidTransform(rh_tf)


euler_angle=MyMath.EulerAngle(rigid_tf,order)

a=euler_angle.A_deg;
b=euler_angle.B_deg;
c=euler_angle.C_deg;

Euler=euler_angle
euler_order=euler_angle.Order
# ---------- end python_2 ----------

# ---- group: To矩阵
python_3 = GhPythonScript(AxisAngle=python.angle_axis)  # -> out, TF
# ---------- python_3: Python ----------
__author__ = "LmShare"
__version__ = "2024.05.10"

import rhinoscriptsyntax as rs
import sys
import clr
import Rhino

sys.path.append('C:\gha\FUROBOT')
clr.AddReference('FUMath')
clr.AddReference('FUROBOTCore')
import MyMath
import FUROBOTCore


#TF=(MyMath.RigidTransform(q)).GetRHMatrix();
#TF=FUROBOTCore.MathCommon.GetRHMatrix((MyMath.RigidTransform(q)))


q=AxisAngle.GetQuat();

TF=FUROBOTCore.MathCommon.GetRHMatrix(MyMath.RigidTransform(q))
# ---------- end python_3 ----------
python_4 = GhPythonScript(rotation_vector=python.rotation_vector)  # -> out, TF
# ---------- python_4: Python ----------
__author__ = "LmShare"
__version__ = "2024.05.10"

import rhinoscriptsyntax as rs
import sys
import clr
import Rhino

sys.path.append('C:\gha\FUROBOT')
clr.AddReference('FUMath')
clr.AddReference('FUROBOTCore')
import MyMath
import FUROBOTCore


#TF=(MyMath.RigidTransform(q)).GetRHMatrix();
#TF=FUROBOTCore.MathCommon.GetRHMatrix((MyMath.RigidTransform(q)))


q=rotation_vector.GetQuat();

TF=FUROBOTCore.MathCommon.GetRHMatrix(MyMath.RigidTransform(q))
# ---------- end python_4 ----------
python_5 = GhPythonScript(EulerAngle=python.Euler)  # -> out, TF
# ---------- python_5: Python ----------
__author__ = "LmShare"
__version__ = "2024.05.10"

import rhinoscriptsyntax as rs
import sys
import clr
import Rhino

sys.path.append('C:\gha\FUROBOT')
clr.AddReference('FUMath')
clr.AddReference('FUROBOTCore')
import MyMath
import FUROBOTCore


#TF=(MyMath.RigidTransform(q)).GetRHMatrix();
#TF=FUROBOTCore.MathCommon.GetRHMatrix((MyMath.RigidTransform(q)))
TF=FUROBOTCore.MathCommon.GetRHMatrix(EulerAngle.RigidTF);
# ---------- end python_5 ----------
python_6 = GhPythonScript(q=python.quaternion)  # -> out, TF
# ---------- python_6: Python ----------
import rhinoscriptsyntax as rs
import sys
import clr
import Rhino

sys.path.append('C:\gha\FUROBOT')
clr.AddReference('FUMath')
clr.AddReference('FUROBOTCore')
import MyMath
import FUROBOTCore

TF=FUROBOTCore.MathCommon.GetRHMatrix((MyMath.RigidTransform(q)))
# ---------- end python_6 ----------

# ----
panel_2 = Panel(python_2.b)
panel_3 = Panel(python_2.a)
panel_4 = Panel(python_2.c)

panel_5 = Panel(python_2.Euler)

panel_6 = Panel(python_2.euler_order)
panel_7 = Panel(python_2.z)
panel_8 = Panel(python_2.x)
panel_9 = Panel(python_2.y)

matrix = DisplayMatrix(python_6.TF)
matrix_2 = DisplayMatrix(python_5.TF)
matrix_3 = DisplayMatrix(python_3.TF)
matrix_4 = DisplayMatrix(python_4.TF)
panel_10 = Panel(python.rotation_vector)

panel_11 = Panel(python.quaternion)
panel_12 = Panel(python.Euler)

panel_13 = Panel(python.angle_axis)
matrix_5 = DisplayMatrix(comp)
panel_14 = Panel("ZYX")
python_7 = GhPythonScript(a=python_2.a, b=python_2.b, c=python_2.c, x=python_2.x, y=python_2.y, z=python_2.z, order_str="XYZ")  # -> euler_angle, TF
# ---------- python_7: Python ----------
__author__ = "LmShare"
__version__ = "2024.04.03"

import rhinoscriptsyntax as rs
import sys
import clr
import Rhino

sys.path.append('C:\gha\FUROBOT')
clr.AddReference('FUMath')
clr.AddReference('FUROBOTCore')
import MyMath
import FUROBOTCore

order_str=order_str.strip()
if order_str=="XYZ":
    order=MyMath.EulerAngleOrder.XYZ;
elif order_str=="ZYZ":
    order=MyMath.EulerAngleOrder.ZYX;
elif order_str=="ZYX":
    order=MyMath.EulerAngleOrder.ZYX;
else:
    order=MyMath.EulerAngleOrder.XYX;

euler_angle=MyMath.EulerAngle(a,b,c,order)

T=FUROBOTCore.MathCommon.GetRHMatrix(euler_angle.RigidTF)

T[0,3]=x
T[1,3]=y
T[2,3]=z

TF=T
# ---------- end python_7 ----------
matrix_6 = DisplayMatrix(python_7.TF)
panel_15 = Panel(python_7.euler_angle)
