# Grasshopper definition FURobotUsePython.gh (Grasshopper 1.0.7)
# plug-ins: FURobot

create_euler_angles = CreateEulerAngles(A=Slider(19.48, range=-90..90), B=Slider(14.9, range=-90..90), C=Slider(20.97, range=-90..90))
rotation_parameter_conversion = RotationParameterConversion(Euler=create_euler_angles, Input=0, Output=6)  # -> Euler, Matrix, Quat, AxisAng, RotateVec
crv = Curve(<curve referenced from the Rhino model>)
crv_2 = Curve(<curve referenced from the Rhino model>)
cp = ControlPoints(Curve=crv)  # -> Points, Weights, Knots
cp_2 = ControlPoints(Curve=crv_2)  # -> Points, Weights, Knots
vec = VectorXYZ(XComponent=Slider(1000, range=0..1000), YComponent=Slider(300, range=0..1000), ZComponent=Slider(500, range=0..1000))  # -> Vector, Length
panel = Panel(rotation_parameter_conversion.Euler)
move = Move(Motion=vec.Vector)  # -> Geometry, Transform
c_script = CSharpScript(
    x=cp.Points,
    y=cp_2.Points,
    Reference=["C:\gha\FUROBOT\FURobotLibrary.dll", "C:\gha\FUROBOT\FUCore.dll", "C:\gha\FUROBOT\FUMath.dll"])  # -> out, A; inputs x: list of Point3d, y: list of Point3d
# ---------- c_script: C# ----------
    //FURobotLibrary.GJKMethod.

    List<FUMath.Vec3f> vlist1 = new List<FUMath.Vec3f>();
    for(int i = 0;i < x.Count - 1;i++)
    {
      FUMath.Vec3f v = new FUMath.Vec3f(x[i].X, x[i].Y, x[i].Z);
      vlist1.Add(v);
    }
    
    List<FUMath.Vec3f> vlist2 = new List<FUMath.Vec3f>();
    for(int i = 0;i < y.Count - 1;i++)
    {
      FUMath.Vec3f v = new FUMath.Vec3f(y[i].X, y[i].Y, y[i].Z);
      vlist2.Add(v);
    }
    
    FUMath.Vec3f initVec = new FUMath.Vec3f(0, 1, 0);

    FUCore.PolyLineSeg Apoly = new FUCore.PolyLineSeg(vlist1);
    FUCore.PolyLineSeg Bpoly = new FUCore.PolyLineSeg(vlist2);
    
    A = FUCore.GJKMethod.GJK2D(Apoly,Bpoly,initVec);
# ---------- c_script: C# additional code ----------
  List<Vector3d> ConvertToVector3dList(List<FUMath.Vec3f> vecList)
  {
    List<Vector3d> v3dlist = new List<Vector3d>();
    for(int i = 0;i < vecList.Count;i++)
    {
      v3dlist.Add(new Vector3d(vecList[i].X, vecList[i].Y, vecList[i].Z));
    }
    return v3dlist;
  }
# ---------- end c_script ----------
merge = Merge(Data1=rotation_parameter_conversion.Matrix, Data2=move.Transform)
panel_2 = Panel(c_script.A)
comp = Compound(Transforms=merge)

# ---- group: From矩阵
python = GhPythonScript(TF=comp)  # -> out, Euler, quaternion, angle_axis, rotation_vector; inputs TF: Transform
# ---------- python: Python ----------
__author__ = "LmShare"
__version__ = "2024.04.03"

import rhinoscriptsyntax as rs
import sys
import clr
import Rhino

sys.path.append('C:\gha\FUROBOT')
clr.AddReference('FUMath')
clr.AddReference('FUROBOTCore')
import FUMath
import FUROBOTCore

x=TF[0,3]
y=TF[1,3]
z=TF[2,3]

rh_mat=Rhino.Geometry.Matrix(TF)
order=FUMath.EulerAngleOrder.ZYX

rh_tf=FUROBOTCore.MathCommon.ConvertToTransform(rh_mat)
rigid_tf=FUROBOTCore.MathCommon.GetRigidTransform(rh_tf)

euler_angle=FUMath.EulerAngle(rigid_tf,order)

a=euler_angle.A_deg
b=euler_angle.B_deg
c=euler_angle.C_deg

Euler=euler_angle

quat=rigid_tf.GetQuat()
quaternion=quat
w=quat.W
x=quat.X

angle_axis=FUMath.AxisAngle(quat)

rotation_vector=FUMath.RotationVector(angle_axis)
# ---------- end python ----------

# ---- group: 分解
python_2 = GhPythonScript(TF=comp)  # -> out, Euler, a, b, c, x, y, z, euler_order; inputs TF: Transform
# ---------- python_2: Python ----------
__author__ = "LmShare"
__version__ = "2024.04.03"

import rhinoscriptsyntax as rs
import sys
import clr
import Rhino

sys.path.append('C:\gha\FUROBOT')
clr.AddReference('FUMath')
clr.AddReference('FUROBOTCore')
import FUMath
import FUROBOTCore

x=TF[0,3]
y=TF[1,3]
z=TF[2,3]

rh_mat=Rhino.Geometry.Matrix(TF)

order=FUMath.EulerAngleOrder.ZYX

rh_tf=FUROBOTCore.MathCommon.ConvertToTransform(rh_mat)
rigid_tf=FUROBOTCore.MathCommon.GetRigidTransform(rh_tf)


euler_angle=FUMath.EulerAngle(rigid_tf,order)

a=euler_angle.A_deg;
b=euler_angle.B_deg;
c=euler_angle.C_deg;

Euler=euler_angle
euler_order=euler_angle.Order
# ---------- end python_2 ----------

# ---- group: To矩阵
python_3 = GhPythonScript(AxisAngle=python.angle_axis)  # -> out, TF
# ---------- python_3: Python ----------
__author__ = "LmShare"
__version__ = "2024.05.10"

import rhinoscriptsyntax as rs
import sys
import clr
import Rhino

sys.path.append('C:\gha\FUROBOT')
clr.AddReference('FUMath')
clr.AddReference('FUROBOTCore')
import FUMath
import FUROBOTCore


#TF=(MyMath.RigidTransform(q)).GetRHMatrix();
#TF=FUROBOTCore.MathCommon.GetRHMatrix((MyMath.RigidTransform(q)))


q=AxisAngle.GetQuat();

TF=FUROBOTCore.MathCommon.GetRHMatrix(FUMath.RigidTransform(q))
# ---------- end python_3 ----------
python_4 = GhPythonScript(rotation_vector=python.rotation_vector)  # -> out, TF
# ---------- python_4: Python ----------
__author__ = "LmShare"
__version__ = "2024.05.10"

import rhinoscriptsyntax as rs
import sys
import clr
import Rhino

sys.path.append('C:\gha\FUROBOT')
clr.AddReference('FUMath')
clr.AddReference('FUROBOTCore')
import FUMath
import FUROBOTCore


#TF=(MyMath.RigidTransform(q)).GetRHMatrix();
#TF=FUROBOTCore.MathCommon.GetRHMatrix((MyMath.RigidTransform(q)))


q=rotation_vector.GetQuat();

TF=FUROBOTCore.MathCommon.GetRHMatrix(FUMath.RigidTransform(q))
# ---------- end python_4 ----------
python_5 = GhPythonScript(EulerAngle=python.Euler)  # -> out, TF
# ---------- python_5: Python ----------
__author__ = "LmShare"
__version__ = "2024.05.10"

import rhinoscriptsyntax as rs
import sys
import clr
import Rhino

sys.path.append('C:\gha\FUROBOT')
clr.AddReference('FUMath')
clr.AddReference('FUROBOTCore')
import FUMath
import FUROBOTCore


#TF=(MyMath.RigidTransform(q)).GetRHMatrix();
#TF=FUROBOTCore.MathCommon.GetRHMatrix((MyMath.RigidTransform(q)))
TF=FUROBOTCore.MathCommon.GetRHMatrix(EulerAngle.RigidTF);
# ---------- end python_5 ----------
python_6 = GhPythonScript(q=python.quaternion)  # -> out, TF
# ---------- python_6: Python ----------
import rhinoscriptsyntax as rs
import sys
import clr
import Rhino

sys.path.append('C:\gha\FUROBOT')
clr.AddReference('FUMath')
clr.AddReference('FUROBOTCore')
import FUMath
import FUROBOTCore

TF=FUROBOTCore.MathCommon.GetRHMatrix((FUMath.RigidTransform(q)))
# ---------- end python_6 ----------

# ----
panel_3 = Panel(python_2.b)
panel_4 = Panel(python_2.a)
panel_5 = Panel(python_2.c)

panel_6 = Panel(python_2.Euler)

panel_7 = Panel(python_2.euler_order)
panel_8 = Panel(python_2.z)
panel_9 = Panel(python_2.x)
panel_10 = Panel(python_2.y)

matrix = DisplayMatrix(python_6.TF)
matrix_2 = DisplayMatrix(python_5.TF)
matrix_3 = DisplayMatrix(python_3.TF)
matrix_4 = DisplayMatrix(python_4.TF)
panel_11 = Panel(python.rotation_vector)

panel_12 = Panel(python.quaternion)
panel_13 = Panel(python.Euler)

panel_14 = Panel(python.angle_axis)
matrix_5 = DisplayMatrix(comp)
panel_15 = Panel("ZYX")
python_7 = GhPythonScript(a=python_2.a, b=python_2.b, c=python_2.c, x=python_2.x, y=python_2.y, z=python_2.z, order_str="XYZ")  # -> euler_angle, TF
# ---------- python_7: Python ----------
__author__ = "LmShare"
__version__ = "2024.04.03"

import rhinoscriptsyntax as rs
import sys
import clr
import Rhino

sys.path.append('C:\gha\FUROBOT')
clr.AddReference('FUMath')
clr.AddReference('FUROBOTCore')
import FUMath
import FUROBOTCore

order_str=order_str.strip()
if order_str=="XYZ":
    order=FUMath.EulerAngleOrder.XYZ;
elif order_str=="ZYZ":
    order=FUMath.EulerAngleOrder.ZYX;
elif order_str=="ZYX":
    order=FUMath.EulerAngleOrder.ZYX;
else:
    order=FUMath.EulerAngleOrder.XYX;

euler_angle=FUMath.EulerAngle(a,b,c,order)

T=FUROBOTCore.MathCommon.GetRHMatrix(euler_angle.RigidTF)

T[0,3]=x
T[1,3]=y
T[2,3]=z

TF=T
# ---------- end python_7 ----------
matrix_6 = DisplayMatrix(python_7.TF)
panel_16 = Panel(python_7.euler_angle)
