# Grasshopper definition sendUDP.gh (Grasshopper 1.0.7)
# plug-ins: FURobot, RobotLibUR

crv = Curve(<curve referenced from the Rhino model>)
merge = Merge(
    Data1=Slider(70, range=0..100),
    Data2=Slider(-76, range=-180..180),
    Data3=Slider(104.019, range=-180..180),
    Data4=Slider(-40, range=-180..180),
    Data5=Slider(0, range=-180..180),
    Data6=Slider(-90, range=-180..180))

# ---- group: Joint cmd
joint_cmd = JointCmd(Joint=merge, RotJointVel=Slider(20, range=1..100), MovJointVel=Slider(100, range=1..300))

# ----
split_by_segment_length = SplitBySegmentLength(Curve=crv, Length=8, Len=8)
rotate_y_axis_π_2 = RotateYAxisΠ2(Plane=split_by_segment_length)

# ---- group: line command
generate_nan = GenerateNaN()
generate_nan_2 = GenerateNaN()
generate_nan_3 = GenerateNaN()
generate_nan_4 = GenerateNaN()
generate_nan_5 = GenerateNaN()
generate_nan_6 = GenerateNaN()
merge_2 = Merge(
    Data1=generate_nan,
    Data2=generate_nan_2,
    Data3=generate_nan_3,
    Data4=generate_nan_4,
    Data5=generate_nan_5,
    Data6=generate_nan_6)
line_command = LineCommand(PLane=rotate_y_axis_π_2, LineVel=Slider(50, range=1..200), FixedValue=merge_2, PTJ=False)

# ----
light_plastic_tool = LightPlasticTool(Normal=0, Usage=0)
R = UR10(Tool=light_plastic_tool)
merge_3 = Merge(Data1=joint_cmd, Data2=line_command)
simulator = RobotSimulator(Slider=Slider(1, range=0..1), Robot=R, CMD=merge_3)  # -> Joint, Geo, Traj, Task, PLane
deconstructjointvaluegroup = DeconstructJointValueGroup(Joint=simulator.Joint)
panel = Panel(deconstructjointvaluegroup)

item = ListItem(List=deconstructjointvaluegroup, Index=0, Wrap=True)  # -> Item, Item1, Item2, Item3, Item4, Item5
panel_2 = Panel(item.Item)
rad = Radians(Degrees=item.Item)
rad_2 = Radians(Degrees=item.Item1)
rad_3 = Radians(Degrees=item.Item2)
rad_4 = Radians(Degrees=item.Item3)
rad_5 = Radians(Degrees=item.Item4)
rad_6 = Radians(Degrees=item.Item5)
concat = Concatenate(
    FragmentA=rad,
    FragmentB=",",
    FragmentC=rad_2,
    FragmentD=",",
    FragmentE=rad_3,
    FragmentN=",",
    FragmentF=rad_4,
    FragmentG=",",
    FragmentH=rad_5,
    FragmentI=",",
    FragmentJ=rad_6)

udpsender = UDPSender(Text=concat, LocalPort=Slider(5555, range=0..10000), RemoteIP="127.0.0.1", RemotePort=Slider(12345, range=0..100000))

panel_3 = Panel(concat)
