# Grasshopper definition simpletest.gh (Grasshopper 1.0.7)
# plug-ins: FURobot, RobotABB, RobotKUKA, RobotLibUR

# ---- group: Joint cmd
merge = Merge(
    Data1=Slider(0, range=-10000..10000),
    Data2=Slider(0, range=-10000..10000),
    Data3=Slider(-20, range=-10000..10000),
    Data4=Slider(0, range=-10000..10000),
    Data5=Slider(-20, range=-10000..10000),
    Data6=Slider(180, range=-10000..10000))
joint_cmd = JointCmd(Joint=merge, RotJointVel=Slider(20, range=1..100), MovJointVel=Slider(100, range=1..300))

# ----
crv = Curve(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)
dbsl = DivideBySegWithLength(Curve=crv, Length=Slider(200, range=0..10000), Len=200)
xy = XYPlane(Origin=dbsl)

rotateyaxishalfpi = RotateYAxisHalfPI(Plane=xy)

generate_nan = GenerateNaN()
num = Number(generate_nan)
panel = Panel(num)
merge_2 = Merge(
    Data1=generate_nan,
    Data2=generate_nan,
    Data3=generate_nan,
    Data4=generate_nan,
    Data5=generate_nan,
    Data6=generate_nan,
    Data7=generate_nan)
line_instruction = LineInstruction(PLane=rotateyaxishalfpi, LineVel=Slider(60.149, range=1..200), FixedValue=merge_2, PTJ=False)

# ---- group: Pose to joint command
generate_nan_2 = GenerateNaN()
generate_nan_3 = GenerateNaN()
generate_nan_4 = GenerateNaN()
generate_nan_5 = GenerateNaN()
generate_nan_6 = GenerateNaN()
generate_nan_7 = GenerateNaN()
merge_3 = Merge(
    Data1=generate_nan_2,
    Data2=generate_nan_3,
    Data3=generate_nan_4,
    Data4=generate_nan_5,
    Data5=generate_nan_6,
    Data6=generate_nan_7)
pose_to_joint_command = PoseToJointCommand(
    Plane=rotateyaxishalfpi,
    RotJointVel=Slider(5, range=1..100),
    MovJointVel=Slider(113.532, range=1..300),
    FixedValue=merge_3)

# ----
renderplanegeo = RenderPlaneGeo(Plane=rotateyaxishalfpi, Scale=100)
light_plastic_tool = LightPlasticTool(Normal=0, Usage=0)
merge_4 = Merge(Data1=joint_cmd, Data2=pose_to_joint_command)
R = UR10(Tool=light_plastic_tool)
R_2 = KR270R2700(Tool=light_plastic_tool)
R_3 = IRB4600R205(Tool=light_plastic_tool)
number_slider = Slider(1, range=0..1)
R_4 = KR270R2700()
R_5 = KR70R2100()
arm_simulator = ArmSimulator(Slider=Slider(1, range=0..1), Robot=R_3, CMD=merge_4, Path="C:\Users\LmScr\Documents\Work\FURobotTutorialDoc\入门案例\aa")  # -> Joint, Geo, Traj, Task, PLane
create_a_serial_robot = CreateASerialRobot(Root=PlaneXY(0, 0, 0), Brand=0)
R_6 = IRB140()
R_7 = UR16e()
R_8 = _100A270()
panel_2 = Panel(arm_simulator.PLane)
detect = DetectedError(Resolution=100)
panel_3 = Panel(detect)
panel_4 = Panel(R_8)
