# Grasshopper definition SingleRail.gh (Grasshopper 1.0.7)
# plug-ins: FURobot, Step6DoFArm

# ---- group: Joint cmd
merge = Merge(
    Data1=Slider(0, range=-1000..3000),
    Data2=Slider(0, range=-10000..10000),
    Data3=Slider(0, range=-10000..10000),
    Data4=Slider(-20, range=-10000..10000),
    Data5=Slider(0, range=-10000..10000),
    Data6=Slider(-20, range=-10000..10000),
    Data7=Slider(180, range=-10000..10000))
joint_cmd = JointCmd(Joint=merge, RotJointVel=Slider(20, range=1..100), MovJointVel=Slider(100, range=1..300))

# ----
crv = Curve(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)
dbsl = DivideBySegWithLength(Curve=crv, Length=Slider(200, range=0..10000), Len=200)
xy = XYPlane(Origin=dbsl)

rotateyaxishalfpi = RotateYAxisHalfPI(Plane=xy)

generate_nan = GenerateNaN()
num = Number(generate_nan)
panel = Panel(num)
merge_2 = Merge(
    Data1=Slider(1000, range=0..1000),
    Data2=generate_nan,
    Data3=generate_nan,
    Data4=generate_nan,
    Data5=generate_nan,
    Data6=generate_nan,
    Data7=generate_nan)
line_instruction = LineInstruction(PLane=rotateyaxishalfpi, LineVel=Slider(50, range=1..200), FixedValue=merge_2, PTJ=False)

renderplanegeo = RenderPlaneGeo(Plane=rotateyaxishalfpi, Scale=100)

# ---- group: Pose to joint command
generate_nan_2 = GenerateNaN()
generate_nan_3 = GenerateNaN()
generate_nan_4 = GenerateNaN()
generate_nan_5 = GenerateNaN()
generate_nan_6 = GenerateNaN()
generate_nan_7 = GenerateNaN()
merge_3 = Merge(
    Data1=generate_nan_2,
    Data2=generate_nan_3,
    Data3=generate_nan_4,
    Data4=generate_nan_5,
    Data5=generate_nan_6,
    Data6=generate_nan_7)
pose_to_joint_command = PoseToJointCommand(Plane=rotateyaxishalfpi, RotJointVel=Slider(20, range=1..100), MovJointVel=Slider(100, range=1..300), FixedValue=merge_3)

# ----
light_plastic_tool = LightPlasticTool(Usage=0)

# ---- group: Create prismatic joint
dom = ConstructDomain(DomainStart=Slider(-10000, range=-100000..100000), DomainEnd=Slider(10000, range=-100000..100000))
vec = VectorXYZ(
    XComponent=Slider(0, range=-10000..10000),
    YComponent=Slider(1000, range=-10000..10000),
    ZComponent=Slider(0, range=-10000..10000))  # -> Vector, Length
pt = ConstructPoint(
    XCoordinate=Slider(0, range=-10000..10000),
    YCoordinate=Slider(0, range=-10000..10000),
    ZCoordinate=Slider(0, range=-10000..10000))
create_prismatic_joint = CreatePrismaticJoint(Ν=vec.Vector, P=pt, Limit=dom)

# ----
mesh = Mesh(<mesh referenced from the Rhino model>)
panel_2 = Panel("C:\ProgramData\test")
number_slider = Slider(1, range=0..1)
mesh_2 = Mesh(<mesh referenced from the Rhino model>)
merge_4 = Merge(Data1=joint_cmd, Data2=line_instruction)
step_manipulator_offline_file_format = StepManipulatorOfflineFileFormat()
R = _100A270(Tool=light_plastic_tool)
create_rod = CreateLink(Mesh=mesh_2, Material=ColourSwatch(SwatchColor=RGB(255, 255, 255)), Density=1000)
create_rod_2 = CreateLink(Mesh=mesh, Material=ColourSwatch(SwatchColor=RGB(102, 102, 102)), Density=1000)
merge_5 = Merge(Data1=create_rod_2, Data2=create_rod)
xy_2 = XYPlane(Origin=Point(43.38348906, -313.3680185, 164.8069916))
create_a_serial_robot = CreateASerialRobot(Flange=xy_2, Joint=create_prismatic_joint, Link=merge_5, Root=PlaneXY(0, 0, 0))
merge_series_robots = MergeSeriesRobot(Robot1=create_a_serial_robot, Robot2=R)
arm_simulator = ArmSimulator(Slider=Slider(1, range=0..1), Robot=merge_series_robots, CMD=flatten(merge_4), TrajPreview=True)  # -> Joint, Geo, Traj, Task, PLane
