# Grasshopper definition toolDof.gh (Grasshopper 1.0.7)
# plug-ins: FURobot, RobotKUKA

divide_by_segment_length = DivideBySegmentLength(Curve=<geometry referenced from the Rhino model>, Length=Slider(100, range=5..1000))  # -> flatten(Point)
xy = XYPlane(Origin=divide_by_segment_length)
number_slider = Slider(30, range=0..1000)
deplane = DeconstructPlane(Plane=xy)  # -> Origin, XAxis, YAxis, ZAxis
range = Range(Domain=Domain(70, 110), Steps=Slider(11, range=0..100))
bnd = Bounds()
dom = ConstructDomain(DomainStart=Slider(0, range=0..100), DomainEnd=Slider(148, range=0..1000))
rot3d = Rotate3D(Geometry=xy, Angle=degrees(range), Center=deplane.Origin, Axis=deplane.YAxis)  # -> Geometry, Transform
range_2 = Range(Domain=dom, Steps=Slider(11, range=0..100))
deplane_2 = DeconstructPlane(Plane=rot3d.Geometry)  # -> Origin, XAxis, YAxis, ZAxis
rot3d_2 = Rotate3D(Geometry=rot3d.Geometry, Angle=degrees(range_2), Center=deplane_2.Origin, Axis=deplane_2.XAxis)  # -> Geometry, Transform

# ---- group: RenderPlaneGeo
renderplanegeo = RenderPlaneGeo(Plane=rot3d_2.Geometry, Scale=Slider(200, range=1..1000))

# ---- group: Joint cmd
merge = Merge(
    Data1=Slider(0, range=-10000..10000),
    Data2=Slider(-90, range=-10000..10000),
    Data3=Slider(90, range=-10000..10000),
    Data4=Slider(0, range=-10000..10000),
    Data5=Slider(-20, range=-10000..10000),
    Data6=Slider(0, range=-10000..10000))
joint_cmd = JointCmd(Joint=merge, RotJointVel=Slider(20, range=1..100), MovJointVel=Slider(100, range=1..300))

# ----
generate_nan = GenerateNaN()
generate_nan_2 = GenerateNaN()
generate_nan_3 = GenerateNaN()
generate_nan_4 = GenerateNaN()
generate_nan_5 = GenerateNaN()
generate_nan_6 = GenerateNaN()
merge_2 = Merge(
    Data1=generate_nan,
    Data2=generate_nan_2,
    Data3=generate_nan_3,
    Data4=generate_nan_4,
    Data5=generate_nan_5,
    Data6=generate_nan_6)
line_command = LineCommand(PLane=rot3d_2.Geometry, LineVel=Slider(50, range=1..200), FixedValue=merge_2, PTJ=False)

# ---- group: Arm simulator
panel = Panel("C:\Users\LmScr\Desktop\MyOfflineProgram")
light_plastic_tool = LightPlasticTool(Usage=4)
R = AgilusKR6KR10R900(Tool=light_plastic_tool)
merge_3 = Merge(Data1=joint_cmd, Data2=line_command)
arm_simulator = ArmSimulator(Slider=Slider(0.355833, range=0..1), Robot=R, CMD=flatten(merge_3), TrajPreview=True)  # -> Joint, Geo, Traj, Task, PLane

# ----
item = ListItem(List=arm_simulator.PLane, Index=0, Wrap=True)  # -> Item, Item1, Item2, Item3, Item4, Item5, Item6, Item7, Item8

# ---- group: RenderPlaneGeo
renderplanegeo_2 = RenderPlaneGeo(Plane=item.Item8, Scale=Slider(195.696, range=1..1000))
