# Grasshopper definition Aubo_CustomRobot.gh (Grasshopper 1.0.7)
# plug-ins: FURobot, Format_KUKA6DoFArm, MeshToolbox

number_slider = Slider(-197, range=-1000..-197)
number_slider_2 = Slider(-201.3, range=-1000..-201.3)

number_slider_3 = Slider(0, range=0..100)
number_slider_4 = Slider(536, range=-10000..10000)
pt = ConstructPoint(XCoordinate=Slider(0, range=-10000..10000), YCoordinate=number_slider, ZCoordinate=Slider(163, range=0..1000))
dom = ConstructDomain(DomainStart=Slider(-10000, range=-100000..100000), DomainEnd=Slider(10000, range=-100000..100000))
vec = VectorXYZ(XComponent=number_slider_3, YComponent=Slider(-1, range=-1..0), ZComponent=number_slider_3)  # -> Vector, Length
create_rotation_joint = CreateRotationJoint(Ω=vec.Vector, P=pt, Limit=dom)

# ---- group: Create rotation joint
number_slider_5 = Slider(0, range=-1..1)
pt_2 = ConstructPoint(
    XCoordinate=Slider(0, range=-10000..10000),
    YCoordinate=Slider(0, range=-10000..10000),
    ZCoordinate=Slider(0, range=-10000..10000))
vec_2 = VectorXYZ(XComponent=number_slider_5, YComponent=number_slider_5, ZComponent=Slider(1, range=0..1))  # -> Vector, Length
dom_2 = ConstructDomain(DomainStart=Slider(-10000, range=-100000..100000), DomainEnd=Slider(10000, range=-100000..100000))
create_rotation_joint_2 = CreateRotationJoint(Ω=vec_2.Vector, P=pt_2, Limit=dom_2)

number_slider_6 = Slider(0, range=0..100)
pt_3 = ConstructPoint(XCoordinate=Slider(0, range=-10000..10000), YCoordinate=number_slider, ZCoordinate=Slider(1410.5, range=0..10000))
vec_3 = VectorXYZ(XComponent=number_slider_6, YComponent=Slider(-1, range=-1..0), ZComponent=number_slider_6)  # -> Vector, Length
dom_3 = ConstructDomain(DomainStart=Slider(-10000, range=-100000..100000), DomainEnd=Slider(10000, range=-100000..100000))
create_rotation_joint_3 = CreateRotationJoint(Ω=vec_3.Vector, P=pt_3, Limit=dom_3)

number_slider_7 = Slider(0, range=0..100)
pt_4 = ConstructPoint(XCoordinate=Slider(0, range=-10000..10000), YCoordinate=number_slider, ZCoordinate=Slider(810, range=0..1000))
dom_4 = ConstructDomain(DomainStart=Slider(-10000, range=-100000..100000), DomainEnd=Slider(10000, range=-100000..100000))
vec_4 = VectorXYZ(XComponent=number_slider_7, YComponent=Slider(1, range=0..1), ZComponent=number_slider_7)  # -> Vector, Length
create_rotation_joint_4 = CreateRotationJoint(Ω=vec_4.Vector, P=pt_4, Limit=dom_4)

number_slider_8 = Slider(0, range=0..100)
number_slider_9 = Slider(1513, range=-10000..10000)
vec_5 = VectorXYZ(XComponent=number_slider_8, YComponent=number_slider_8, ZComponent=Slider(1, range=0..1))  # -> Vector, Length
pt_5 = ConstructPoint(XCoordinate=Slider(0, range=-10000..10000), YCoordinate=number_slider_2, ZCoordinate=number_slider_9)
dom_5 = ConstructDomain(DomainStart=Slider(-10000, range=-100000..100000), DomainEnd=Slider(10000, range=-100000..100000))
create_rotation_joint_5 = CreateRotationJoint(Ω=vec_5.Vector, P=pt_5, Limit=dom_5)

number_slider_10 = Slider(0, range=0..100)
number_slider_11 = Slider(0, range=-10000..10000)
number_slider_12 = Slider(1836, range=-10000..10000)
pt_6 = ConstructPoint(XCoordinate=Slider(0, range=-10000..10000), YCoordinate=number_slider_2, ZCoordinate=number_slider_9)
vec_6 = VectorXYZ(XComponent=number_slider_10, YComponent=Slider(-1, range=-1..0), ZComponent=number_slider_10)  # -> Vector, Length
dom_6 = ConstructDomain(DomainStart=Slider(-10000, range=-100000..100000), DomainEnd=Slider(10000, range=-100000..100000))
create_rotation_joint_6 = CreateRotationJoint(Ω=vec_6.Vector, P=pt_6, Limit=dom_6)

# ----
merge = Merge(
    Data1=create_rotation_joint_2,
    Data2=create_rotation_joint,
    Data3=create_rotation_joint_4,
    Data4=create_rotation_joint_3,
    Data5=create_rotation_joint_5,
    Data6=create_rotation_joint_6)
panel = Panel(merge)
swatch = ColourSwatch(SwatchColor=RGB(255, 139, 15))
shader = Shader(swatch)
panel_2 = Panel("C:\Users\LmScr\Documents\Work\FabUnionRobot\FUROBOT\Resources\mesh\aubo\i10\aubo_i10_g")
mesh = Mesh(<mesh referenced from the Rhino model>)
create_rod = CreateLink(Mesh=mesh, Material=shader, Density=1000)

swatch_2 = ColourSwatch(SwatchColor=RGB(61, 61, 61))
mesh_2 = Mesh(<mesh referenced from the Rhino model>)
mesh_3 = Mesh(<mesh referenced from the Rhino model>)
mesh_4 = Mesh(<mesh referenced from the Rhino model>)
swatch_3 = ColourSwatch(SwatchColor=RGB(184, 184, 184))
mesh_5 = Mesh(<mesh referenced from the Rhino model>)
mesh_6 = Mesh(<mesh referenced from the Rhino model>)
swatch_4 = ColourSwatch(SwatchColor=RGB(31, 29, 29))
swatch_5 = ColourSwatch(SwatchColor=RGB(214, 214, 214))
swatch_6 = ColourSwatch(SwatchColor=RGB(184, 184, 184))
swatch_7 = ColourSwatch(SwatchColor=RGB(255, 159, 33))
mesh_7 = Mesh(<mesh referenced from the Rhino model>)
mesh_8 = Mesh(<mesh referenced from the Rhino model>)
mesh_9 = Mesh(<mesh referenced from the Rhino model>)
mesh_10 = Mesh(<mesh referenced from the Rhino model>)
mesh_11 = Mesh(<mesh referenced from the Rhino model>)
mesh_12 = Mesh(<mesh referenced from the Rhino model>)
mesh_13 = Mesh(<mesh referenced from the Rhino model>)
create_rod_2 = CreateLink(Mesh=mesh_8, Material=ColourSwatch(SwatchColor=RGB(64, 61, 61)), Density=1000)
create_rod_3 = CreateLink(Mesh=mesh_6, Material=swatch, Density=1000)
create_rod_4 = CreateLink(Mesh=mesh_4, Material=swatch_2, Density=1000)
create_rod_5 = CreateLink(Mesh=mesh_7, Material=swatch_4, Density=1000)
create_rod_6 = CreateLink(Mesh=mesh_10, Material=shader, Density=1000)
create_rod_7 = CreateLink(Mesh=mesh_12, Material=swatch_4, Density=1000)
create_rod_8 = CreateLink(Mesh=mesh_5, Material=swatch_2, Density=1000)
create_rod_9 = CreateLink(Mesh=mesh_2, Material=swatch, Density=1000)
create_rod_10 = CreateLink(Mesh=mesh_9, Material=ColourSwatch(SwatchColor=RGB(201, 197, 197)), Density=1000)
create_rod_11 = CreateLink(Mesh=mesh_13, Material=swatch, Density=1000)
create_rod_12 = CreateLink(Mesh=mesh_11, Material=swatch_2, Density=1000)
create_rod_13 = CreateLink(Mesh=mesh_3, Material=swatch_4, Density=1000)
create_a_link_group = CreateALinkGroup(Link1=create_rod_5)
create_a_link_group_2 = CreateALinkGroup(Link1=create_rod_6, Link2=create_rod_7)
create_a_link_group_3 = CreateALinkGroup(Link1=create_rod_13, Link2=create_rod)
create_a_link_group_4 = CreateALinkGroup(Link1=create_rod_3, Link2=create_rod_8)
create_a_link_group_5 = CreateALinkGroup(Link1=create_rod_9, Link2=create_rod_4)
create_a_link_group_6 = CreateALinkGroup(Link1=create_rod_11, Link2=create_rod_12)
create_a_link_group_7 = CreateALinkGroup(Link1=create_rod_2, Link2=create_rod_10)
merge_2 = Merge(
    Data1=create_a_link_group,
    Data2=create_a_link_group_2,
    Data3=create_a_link_group_3,
    Data4=create_a_link_group_4,
    Data5=create_a_link_group_5,
    Data6=create_a_link_group_6,
    Data7=create_a_link_group_7)

meshtoolboxcomponent = MeshToolboxComponent(Mesh=mesh_9, Path=panel_2)
light_plastic_tool = LightPlasticTool(Usage=0)
R = I10(Tool=light_plastic_tool)
panel_3 = Panel(light_plastic_tool)
crv = Curve(<curve referenced from the Rhino model>)
dbsl = DivideBySegWithLength(Curve=crv, Length=Slider(100, range=0..100), Len=100)
xy = XYPlane(Origin=dbsl)
merge_3 = Merge(
    Data1=Slider(0, range=-180..180),
    Data2=Slider(12.4, range=0..100),
    Data3=Slider(40, range=0..100),
    Data4=Slider(17, range=0..100),
    Data5=Slider(-61, range=-100..-61),
    Data6=Slider(0, range=0..100))
deplane = DeconstructPlane(Plane=xy)  # -> Origin, XAxis, YAxis, ZAxis
rotateyaxishalfpi = RotateYAxisHalfPI(Plane=dbsl)
merge_4 = Merge(
    Data1=Slider(0, range=-180..180),
    Data2=Slider(0, range=-180..180),
    Data3=Slider(90, range=-180..180),
    Data4=Slider(-90, range=-180..180),
    Data5=Slider(-90, range=-180..180),
    Data6=Slider(90, range=0..100))

# ---- group: Joint cmd
joint_cmd = JointCmd(Joint=merge_4, RotJointVel=Slider(20, range=1..100), MovJointVel=Slider(100, range=1..300))

# ----
pt_7 = ConstructPoint(
    XCoordinate=Slider(0, range=0..100),
    YCoordinate=Slider(-295.3, range=-1000..-295.3),
    ZCoordinate=Slider(1513, range=0..10000))
xy_2 = XYPlane(Origin=pt_7)
deplane_2 = DeconstructPlane(Plane=xy_2)  # -> Origin, XAxis, YAxis, ZAxis
rot3d = Rotate3D(Geometry=xy, Angle=degrees(Slider(73.58, range=0..180)), Center=deplane.Origin, Axis=deplane.YAxis)  # -> Geometry, Transform

# ---- group: line command
generate_nan = GenerateNaN()
generate_nan_2 = GenerateNaN()
generate_nan_3 = GenerateNaN()
generate_nan_4 = GenerateNaN()
generate_nan_5 = GenerateNaN()
generate_nan_6 = GenerateNaN()
merge_5 = Merge(
    Data1=generate_nan,
    Data2=generate_nan_2,
    Data3=generate_nan_3,
    Data4=generate_nan_4,
    Data5=generate_nan_5,
    Data6=generate_nan_6)
line_command = LineCommand(PLane=rot3d.Geometry, LineVel=Slider(50, range=1..200), FixedValue=merge_5, PTJ=False)

# ----
xy_3 = XYPlane(Origin=Point(0, 0, 0))
rot3d_2 = Rotate3D(Geometry=xy_2, Angle=1.570796327, Center=deplane_2.Origin, Axis=deplane_2.XAxis)  # -> Geometry, Transform
renderplanegeo = RenderPlaneGeo(Plane=rot3d.Geometry, Scale=100)
panel_4 = Panel(rot3d_2.Geometry)
matrix = DisplayMatrix(rot3d_2.Transform)
create_a_serial_robot = CreateASerialRobot(Tool=light_plastic_tool, Flange=rot3d_2.Geometry, Joint=merge, Link=merge_2, Root=xy_3, Brand=0)
panel_5 = Panel(create_a_serial_robot)
merge_6 = Merge(Data1=joint_cmd, Data2=line_command, Data3=joint_cmd)  # -> flatten(Result)
arm_kuka_task = ArmKUKATask()
panel_6 = Panel(R)
arm_simulator = ArmSimulator(
    Slider=Slider(1, range=0..1),
    Robot=R,
    CMD=merge_6,
    Format=arm_kuka_task,
    Path="C:\Users\LmScr\Documents\Work\FURobotTutorialDoc\自定义机器人")  # -> Joint, Geo, Traj, Task, PLane
renderplanegeo_2 = RenderPlaneGeo(Plane=arm_simulator.PLane, Scale=100)
