# Grasshopper definition 2link.gh (Grasshopper 1.0.7)
# plug-ins: FURobot

construct_point = ConstructPoint(XCoordinate=Slider(900, range=0..1000), YCoordinate=0, ZCoordinate=0)

# ---- group: ConstrucRotationJoint
dom = ConstructDomain(DomainStart=Slider(-10000, range=-100000..100000), DomainEnd=Slider(10000, range=-100000..100000))
pt = ConstructPoint(
    XCoordinate=Slider(0, range=-10000..10000),
    YCoordinate=Slider(0, range=-10000..10000),
    ZCoordinate=Slider(0, range=-10000..10000))
vec = VectorXYZ(XComponent=Slider(0, range=-1..1), YComponent=Slider(0, range=-1..1), ZComponent=Slider(1, range=-1..1))  # -> Vector, Length
construcrotationjoint = ConstrucRotationJoint(Ω=vec.Vector, P=construct_point, Limit=dom)

# ----
construct_point_2 = ConstructPoint(XCoordinate=Slider(1800, range=0..10000), YCoordinate=0, ZCoordinate=0)

# ---- group: ConstrucRotationJoint
dom_2 = ConstructDomain(DomainStart=Slider(-10000, range=-100000..100000), DomainEnd=Slider(10000, range=-100000..100000))
pt_2 = ConstructPoint(
    XCoordinate=Slider(0, range=-10000..10000),
    YCoordinate=Slider(0, range=-10000..10000),
    ZCoordinate=Slider(0, range=-10000..10000))
vec_2 = VectorXYZ(XComponent=Slider(0, range=-1..1), YComponent=Slider(0, range=-1..1), ZComponent=Slider(1, range=-1..1))  # -> Vector, Length
construcrotationjoint_2 = ConstrucRotationJoint(Ω=vec_2.Vector, P=construct_point_2, Limit=dom_2)

# ----
mesh = Mesh(<mesh referenced from the Rhino model>)
mesh_2 = Mesh(<mesh referenced from the Rhino model>)
mesh_3 = Mesh(<mesh referenced from the Rhino model>)
mesh_4 = Mesh(<mesh referenced from the Rhino model>)
mesh_5 = Mesh(<mesh referenced from the Rhino model>)
colour_swatch = ColourSwatch(SwatchColor=RGBA(0, 255, 166, 144))
colour_swatch_2 = ColourSwatch(SwatchColor=RGBA(212, 107, 42, 172))
construct_domain = ConstructDomain(DomainStart=Slider(-180, range=-1000..-180), DomainEnd=Slider(180, range=0..1000))
colour_swatch_3 = ColourSwatch(SwatchColor=RGB(214, 214, 214))
create_rod = CreateLink(Mesh=mesh_4, Material=ColourSwatch(SwatchColor=RGB(143, 143, 143)), Density=1000)
create_rod_2 = CreateLink(Mesh=mesh, Material=ColourSwatch(SwatchColor=RGB(163, 163, 163)), Density=1000)
create_rod_3 = CreateLink(Mesh=mesh_2, Material=colour_swatch, Density=1000)
create_rod_4 = CreateLink(Mesh=mesh_3, Material=ColourSwatch(SwatchColor=RGB(222, 222, 222)), Density=1000)
create_rod_5 = CreateLink(Mesh=mesh_5, Material=colour_swatch, Density=1000)
construct_point_3 = ConstructPoint(XCoordinate=0, YCoordinate=0, ZCoordinate=0)
create_a_link_group = CreateALinkGroup(Link1=create_rod_5)
create_a_link_group_2 = CreateALinkGroup(Link1=create_rod)
create_a_link_group_3 = CreateALinkGroup(Link1=create_rod_3, Link2=create_rod_4)
unit_z = UnitZ(Factor=1)
create_a_link_group_4 = CreateALinkGroup(Link1=create_rod_2)
number_slider = Slider(-100, range=-100..-99)
unit_z_2 = UnitZ(Factor=Slider(1000, range=0..1000))
construct_moving_joint = ConstructMovingJoint(Ν=unit_z_2, Limit=null, Limit_2=Domain(nan, nan))
mesh_6 = Mesh(<mesh referenced from the Rhino model>)
construcrotationjoint_3 = ConstrucRotationJoint(Ω=unit_z, P=construct_point_3, Limit=construct_domain)
mesh_7 = Mesh(<mesh referenced from the Rhino model>)
create_rod_6 = CreateLink(Mesh=mesh_6, Material=ColourSwatch(SwatchColor=RGB(133, 133, 133)), Density=1000)
number_slider_2 = Slider(980, range=0..1000)
merge = Merge(Data1=construct_moving_joint, Data2=construcrotationjoint_3, Data3=construcrotationjoint)
panel = Panel(merge)
getmatrixfromxyzabc = GetMatrixFromXYZABC(X=0, Y=0, Z=Slider(-280, range=-1000..-280), A=0, B=0, C=0)  # -> XYZABC, Matrix
create_rod_7 = CreateLink(Mesh=mesh_7, Material=ColourSwatch(SwatchColor=RGB(133, 133, 133)), Density=1000)
number_slider_3 = Slider(700, range=0..1000)
merge_2 = Merge(Data1=create_a_link_group, Data2=create_a_link_group_2, Data3=create_a_link_group_4, Data4=create_a_link_group_3)
create_a_link_group_5 = CreateALinkGroup(Link1=create_rod_6, Link2=create_rod_7)
construct_point_4 = ConstructPoint(XCoordinate=Slider(1800, range=0..10000), YCoordinate=0, ZCoordinate=Slider(1000, range=0..1000))
curve = Curve(<curve referenced from the Rhino model>)
dividebysegwithlength = DivideBySegWithLength(Curve=curve, Length=Slider(100, range=0..100), Len=100)
matrix = DisplayMatrix(getmatrixfromxyzabc.Matrix)
merge_3 = Merge(
    Data1=Slider(200, range=0..1000),
    Data2=Slider(-70, range=-100..-70),
    Data3=Slider(60, range=0..100),
    Data4=Slider(0, range=0..100))
xy_plane = XYPlane(Origin=dividebysegwithlength)
xy_plane_2 = XYPlane(Origin=construct_point_4)
deplane = DeconstructPlane(Plane=xy_plane)  # -> Origin, XAxis, YAxis, ZAxis
rotate_y_axis_π_2 = RotateYAxisΠ2(Plane=xy_plane)

# ---- group: Construct_X_CMD_PTP_extend_v3
generate_nan = GenerateNaN()
generate_nan_2 = GenerateNaN()
generate_nan_3 = GenerateNaN()
merge_4 = Merge(Data1=generate_nan, Data2=generate_nan_2, Data3=generate_nan_3)
construct_x_cmd_ptp_extend_v3 = Construct_X_CMD_PTP_extend_v3(Plane=rotate_y_axis_π_2, RotJointVel=Slider(20, range=1..100), MovJointVel=Slider(100, range=1..300), FixedValue=merge_4)

# ----
rot3d = Rotate3D(Geometry=xy_plane, Angle=degrees(Slider(-97, range=-180..180)), Center=deplane.Origin, Axis=deplane.ZAxis)  # -> Geometry, Transform
create_end_effector = CreateEndEffector(LinkGroup=create_a_link_group_5, Transform=getmatrixfromxyzabc.Matrix, Normal=2, Usage=2)
renderplanegeo = RenderPlaneGeo(Plane=rot3d.Geometry, Scale=100)
panel_2 = Panel(xy_plane)

# ---- group: Joint cmd
number_slider_4 = Slider(0, range=-10000..10000)
merge_5 = Merge(
    Data1=Slider(-104.443, range=-10000..10000),
    Data2=Slider(-1.318, range=-10000..10000),
    Data3=Slider(45.605, range=-10000..10000))
joint_cmd = JointCmd(Joint=merge_5, RotJointVel=Slider(20, range=1..100), MovJointVel=Slider(100, range=1..300))

number_slider_5 = Slider(0, range=-10000..10000)
merge_6 = Merge(
    Data1=Slider(-104.443, range=-10000..10000),
    Data2=Slider(-1.318, range=-10000..10000),
    Data3=Slider(45.605, range=-10000..10000))
joint_cmd_2 = JointCmd(Joint=merge_6, RotJointVel=Slider(20, range=1..100), MovJointVel=Slider(100, range=1..300))

# ----
panel_3 = Panel(rotate_y_axis_π_2)

# ---- group: line command
generate_nan_4 = GenerateNaN()
generate_nan_5 = GenerateNaN()
generate_nan_6 = GenerateNaN()
merge_7 = Merge(Data1=generate_nan_4, Data2=generate_nan_5, Data3=generate_nan_6)
line_command = LineCommand(PLane=rot3d.Geometry, LineVel=Slider(30, range=1..200), FixedValue=merge_7, PTJ=False)

# ----
create_a_serial_robot = CreateASerialRobot(Tool=create_end_effector, Flange=xy_plane_2, Joint=merge, Link=merge_2, Root=PlaneXY(0, 0, 0))
R = _100A270()
merge_8 = Merge(Data1=joint_cmd, Data2=line_command)
arm_simulator = ArmSimulator(Slider=Slider(1, range=0..1), Robot=create_a_serial_robot, CMD=merge_8)  # -> Joint, Geo, Traj, Task, PLane
number_slider_6 = Slider(500, range=0..1000)
renderplanegeo_2 = RenderPlaneGeo(Plane=arm_simulator.PLane, Scale=100)
