# Grasshopper definition CustomRobot.gh (Grasshopper 1.0.8)
# plug-ins: Format_KUKA6DoFArm, FURobot

# ---- group: Create rotation joint
number_slider = Slider(0, range=-1..1)
pt = ConstructPoint(
    XCoordinate=Slider(0, range=-10000..10000),
    YCoordinate=Slider(0, range=-10000..10000),
    ZCoordinate=Slider(0, range=-10000..10000))
vec = VectorXYZ(XComponent=number_slider, YComponent=number_slider, ZComponent=Slider(-1, range=-1..0))  # -> Vector, Length
dom = ConstructDomain(DomainStart=Slider(-10000, range=-100000..100000), DomainEnd=Slider(10000, range=-100000..100000))
create_rotation_joint = CreateRotationJoint(Ω=vec.Vector, P=pt, Limit=dom)

number_slider_2 = Slider(0, range=0..100)
pt_2 = ConstructPoint(
    XCoordinate=Slider(260, range=-10000..10000),
    YCoordinate=Slider(0, range=-10000..10000),
    ZCoordinate=Slider(1836, range=-10000..10000))
vec_2 = VectorXYZ(XComponent=Slider(-1, range=-1..0), YComponent=number_slider_2, ZComponent=number_slider_2)  # -> Vector, Length
dom_2 = ConstructDomain(DomainStart=Slider(-10000, range=-100000..100000), DomainEnd=Slider(10000, range=-100000..100000))
create_rotation_joint_2 = CreateRotationJoint(Ω=vec_2.Vector, P=pt_2, Limit=dom_2)

number_slider_3 = Slider(0, range=0..100)
pt_3 = ConstructPoint(
    XCoordinate=Slider(0, range=-10000..10000),
    YCoordinate=Slider(0, range=-10000..10000),
    ZCoordinate=Slider(1836, range=-10000..10000))
vec_3 = VectorXYZ(XComponent=Slider(-1, range=-1..0), YComponent=number_slider_3, ZComponent=number_slider_3)  # -> Vector, Length
dom_3 = ConstructDomain(DomainStart=Slider(-10000, range=-100000..100000), DomainEnd=Slider(10000, range=-100000..100000))
create_rotation_joint_3 = CreateRotationJoint(Ω=vec_3.Vector, P=pt_3, Limit=dom_3)

# ----
number_slider_4 = Slider(0, range=0..100)
pt_4 = ConstructPoint(
    XCoordinate=Slider(260, range=-10000..10000),
    YCoordinate=Slider(0, range=-10000..10000),
    ZCoordinate=Slider(536, range=-10000..10000))
dom_4 = ConstructDomain(DomainStart=Slider(-10000, range=-100000..100000), DomainEnd=Slider(10000, range=-100000..100000))
vec_4 = VectorXYZ(XComponent=number_slider_4, YComponent=Slider(1, range=0..1), ZComponent=number_slider_4)  # -> Vector, Length
create_rotation_joint_4 = CreateRotationJoint(Ω=vec_4.Vector, P=pt_4, Limit=dom_4)

# ---- group: Create rotation joint
number_slider_5 = Slider(0, range=0..100)
pt_5 = ConstructPoint(
    XCoordinate=Slider(260, range=-10000..10000),
    YCoordinate=Slider(0, range=-10000..10000),
    ZCoordinate=Slider(1636, range=-10000..10000))
dom_5 = ConstructDomain(DomainStart=Slider(-10000, range=-100000..100000), DomainEnd=Slider(10000, range=-100000..100000))
vec_5 = VectorXYZ(XComponent=number_slider_5, YComponent=Slider(1, range=0..1), ZComponent=number_slider_5)  # -> Vector, Length
create_rotation_joint_5 = CreateRotationJoint(Ω=vec_5.Vector, P=pt_5, Limit=dom_5)

number_slider_6 = Slider(0, range=0..100)
pt_6 = ConstructPoint(
    XCoordinate=Slider(1414, range=-10000..10000),
    YCoordinate=Slider(0, range=-10000..10000),
    ZCoordinate=Slider(1836, range=-10000..10000))
vec_6 = VectorXYZ(XComponent=number_slider_6, YComponent=Slider(1, range=0..1), ZComponent=number_slider_6)  # -> Vector, Length
dom_6 = ConstructDomain(DomainStart=Slider(-10000, range=-100000..100000), DomainEnd=Slider(10000, range=-100000..100000))
create_rotation_joint_6 = CreateRotationJoint(Ω=vec_6.Vector, P=pt_6, Limit=dom_6)

# ----
merge = Merge(
    Data1=create_rotation_joint,
    Data2=create_rotation_joint_4,
    Data3=create_rotation_joint_5,
    Data4=create_rotation_joint_2,
    Data5=create_rotation_joint_6,
    Data6=create_rotation_joint_3)

swatch = ColourSwatch(SwatchColor=RGB(255, 151, 15))
mesh = Mesh(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)
mesh_2 = Mesh(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)
mesh_3 = Mesh(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)
mesh_4 = Mesh(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)
mesh_5 = Mesh(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)
mesh_6 = Mesh(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)
mesh_7 = Mesh(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)
mesh_8 = Mesh(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)
mesh_9 = Mesh(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)
mesh_10 = Mesh(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)
swatch_2 = ColourSwatch(SwatchColor=RGB(255, 159, 33))
mesh_11 = Mesh(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)
mesh_12 = Mesh(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)
create_rod = CreateLink(Mesh=mesh, Material=ColourSwatch(SwatchColor=RGB(189, 189, 189)), Density=1000)
create_rod_2 = CreateLink(Mesh=mesh_2, Material=swatch, Density=1000)
create_rod_3 = CreateLink(Mesh=mesh_3, Material=ColourSwatch(SwatchColor=RGB(214, 214, 214)), Density=1000)
create_rod_4 = CreateLink(Mesh=mesh_4, Material=swatch, Density=1000)
create_rod_5 = CreateLink(Mesh=mesh_5, Material=swatch, Density=1000)
create_rod_6 = CreateLink(Mesh=mesh_6, Material=ColourSwatch(SwatchColor=RGB(184, 184, 184)), Density=1000)
create_rod_7 = CreateLink(Mesh=mesh_7, Material=swatch, Density=1000)
create_rod_8 = CreateLink(Mesh=mesh_8, Material=ColourSwatch(SwatchColor=RGB(184, 184, 184)), Density=1000)
create_rod_9 = CreateLink(Mesh=mesh_9, Material=ColourSwatch(SwatchColor=RGB(184, 184, 184)), Density=1000)
create_rod_10 = CreateLink(Mesh=mesh_10, Material=swatch, Density=1000)
create_rod_11 = CreateLink(Mesh=mesh_12, Material=ColourSwatch(SwatchColor=RGB(201, 201, 201)), Density=1000)
create_rod_12 = CreateLink(Mesh=mesh_11, Material=ColourSwatch(SwatchColor=RGB(184, 184, 184)), Density=1000)
create_a_link_group = CreateALinkGroup(Link1=create_rod)
create_a_link_group_2 = CreateALinkGroup(Link1=create_rod_2, Link2=create_rod_3)
create_a_link_group_3 = CreateALinkGroup(Link1=create_rod_4)
create_a_link_group_4 = CreateALinkGroup(Link1=create_rod_5, Link2=create_rod_6)
create_a_link_group_5 = CreateALinkGroup(Link1=create_rod_7, Link2=create_rod_8, Link3=create_rod_9)
create_a_link_group_6 = CreateALinkGroup(Link1=create_rod_10, Link2=create_rod_12)
create_a_link_group_7 = CreateALinkGroup(Link1=create_rod_11)
create_a_link_group_8 = CreateALinkGroup(Link1=create_rod_11, Link2=create_rod_12)
merge_2 = Merge(
    Data1=create_a_link_group,
    Data2=create_a_link_group_2,
    Data3=create_a_link_group_3,
    Data4=create_a_link_group_4,
    Data5=create_a_link_group_5,
    Data6=create_a_link_group_6,
    Data7=create_a_link_group_7)

light_plastic_tool = LightPlasticTool(Usage=0)
panel = Panel(light_plastic_tool)
crv = Curve(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)
dbsl = DivideBySegWithLength(Curve=crv, Length=Slider(100, range=0..100), Len=100)
merge_3 = Merge(
    Data1=Slider(-11, range=-100..-11),
    Data2=Slider(22, range=0..100),
    Data3=Slider(48, range=0..100),
    Data4=Slider(0, range=0..100),
    Data5=Slider(-61, range=-100..-61),
    Data6=Slider(0, range=0..100))

# ---- group: Joint cmd
joint_cmd = JointCmd(Joint=merge_3, RotJointVel=Slider(20, range=1..100), MovJointVel=Slider(100, range=1..300))

# ----
xy = XYPlane(Origin=Point(0, 0, 0))
c_script = CSharpScript()  # -> out, A
# ---------- c_script: C# ----------
    Matrix M = new Matrix(4, 4);
    M[0, 0] = 0;
    M[0, 1] = 0;
    M[0, 2] = 1;
    M[0, 3] = 1614;

    M[1, 0] = 0;
    M[1, 1] = 1;
    M[1, 2] = 0;
    M[1, 3] = 0;

    M[2, 0] = -1;
    M[2, 1] = 0;
    M[2, 2] = 0;
    M[2, 3] = 1836;

    //    M[3, 0] = 0;
    //    M[3, 1] = 0;
    //    M[3, 2] = 0;
    M[3, 3] = 1;
    A = M;
# ---------- end c_script ----------
rotateyaxishalfpi = RotateYAxisHalfPI(Plane=dbsl)

# ---- group: line command
generate_nan = GenerateNaN()
generate_nan_2 = GenerateNaN()
generate_nan_3 = GenerateNaN()
generate_nan_4 = GenerateNaN()
generate_nan_5 = GenerateNaN()
generate_nan_6 = GenerateNaN()
merge_4 = Merge(
    Data1=generate_nan,
    Data2=generate_nan_2,
    Data3=generate_nan_3,
    Data4=generate_nan_4,
    Data5=generate_nan_5,
    Data6=generate_nan_6)
line_command = LineCommand(PLane=rotateyaxishalfpi, LineVel=Slider(50, range=1..200), FixedValue=merge_4, PTJ=False)

# ----
transform = Transform(Geometry=xy, Transform=c_script.A)
xy_2 = XYPlane(Origin=Point(0, 0, 0))
merge_5 = Merge(Data1=joint_cmd, Data2=line_command)  # -> flatten(Result)
create_a_serial_robot = CreateASerialRobot(Tool=light_plastic_tool, Flange=transform, Joint=merge, Link=merge_2, Root=xy_2, Brand=0)
arm_kuka_task = ArmKUKATask()
arm_simulator = ArmSimulator(
    Slider=Slider(0, range=0..1),
    Robot=create_a_serial_robot,
    CMD=flatten(merge_5),
    Format=arm_kuka_task,
    Path="C:\Users\LmScr\Documents\Work\FURobotTutorialDoc\自定义机器人",
    Key_ProgramSwt="False",
    Key_TrajSwt="False")  # -> Joint, Geo, Traj, Task, PLane
