# Grasshopper definition 避障.gh (Grasshopper 1.0.7)
# plug-ins: FURobot, RobotKUKA

# ---- group: 目标姿态
merge = Merge(
    Data1=Slider(-44.2, range=-90..90),
    Data2=Slider(-62.6, range=-90..90),
    Data3=Slider(122, range=0..1000),
    Data4=Slider(-48.4, range=-90..90),
    Data5=Slider(-68.94, range=-90..90),
    Data6=Slider(22, range=-90..90))

# ---- group: 障碍几何体
mesh = Mesh(<mesh referenced from the Rhino model>)
mesh_2 = Mesh(<mesh referenced from the Rhino model>)
merge_2 = Merge(Data1=mesh, Data2=mesh_2)

# ---- group: 初始姿态
merge_3 = Merge(
    Data1=Slider(33.35, range=-90..90),
    Data2=Slider(-69.6, range=-90..90),
    Data3=Slider(131.79, range=0..1000),
    Data4=Slider(35.9, range=0..100),
    Data5=Slider(-68, range=-100..-68),
    Data6=Slider(-14, range=-90..90))

# ----
light_plastic_tool_head = LightPlasticToolHead(Normal=0, Usage=0)
R = AgilusKR6KR10R900(Tool=light_plastic_tool_head)

panel = Panel(merge)
panel_2 = Panel(merge_3)

# ---- group: 关节限位设置 单位【角度制】
dom = ConstructDomain(DomainStart=Slider(-90, range=-100..-90), DomainEnd=Slider(90, range=0..1000))
dom_2 = ConstructDomain(DomainStart=Slider(-180, range=-1000..-180), DomainEnd=Slider(180, range=180..1000))
dom_3 = ConstructDomain(DomainStart=Slider(-90, range=-100..-90), DomainEnd=Slider(120, range=120..1000))
dom_4 = ConstructDomain(DomainStart=Slider(-180, range=-1000..-180), DomainEnd=Slider(180, range=0..1000))
dom_5 = ConstructDomain(DomainStart=Slider(-100, range=-100..-99), DomainEnd=Slider(100, range=0..100))
dom_6 = ConstructDomain(DomainStart=Slider(-120, range=-1000..-120), DomainEnd=Slider(30, range=30..100))
merge_4 = Merge(Data1=dom_5, Data2=dom_6, Data3=dom_3, Data4=dom_4, Data5=dom, Data6=dom_2)

# ---- group: 避障计算
obstacle_solver = ObstacleSolver(Robot=R, StartJ=merge_3, EndJ=merge, Mesh=merge_2, SampleNum=1000, Interval=merge_4)

# ---- group: new
djvg = DeconstructJointValueGroup(Joint=obstacle_solver)

# ----
joint_command = JointCommand(Joint=djvg, RotJointVel=Slider(20, range=1..100), MovJointVel=Slider(100, range=1..300))

# ---- group: Joint cmd
merge_5 = Merge(
    Data1=Slider(0, range=-10000..10000),
    Data2=Slider(0, range=-10000..10000),
    Data3=Slider(0, range=-10000..10000),
    Data4=Slider(0, range=-10000..10000),
    Data5=Slider(0, range=-10000..10000),
    Data6=Slider(0, range=-10000..10000))
joint_cmd = JointCmd(Joint=djvg, RotJointVel=Slider(20, range=1..100), MovJointVel=Slider(100, range=1..300))

# ----
panel_3 = Panel(djvg)
模拟器 = 机器人模拟器(Slider=Slider(1, range=0..1), Robot=R, CMD=joint_cmd)  # -> Joint, Geo, Traj, Task, PLane
panel_4 = Panel(joint_cmd)
